# Dynamo graph script.dyn "2" (Dynamo 2.6.1.8786)

# group: EXCEL DATABASE
code_block = CodeBlock { "667-04"; }
excel_database = Python(IN[0]=code_block)
# ---------- excel_database.python (77 lines) ----------
import clr

clr.AddReference('System.Windows.Forms')
from System.Windows.Forms import MessageBox, MessageBoxButtons, MessageBoxIcon

class ValidationError(Exception):
	def __init__(self, typeError = "Error", messageError = "An error occurred"):
		self._typeError = typeError
		self._messageError = messageError
		Exception.__init__(self, self._typeError)
		self.CMessageBox()
		
	def __str__(self):
		return "{} : {}".format(self._typeError , self._messageError)
		
	def CMessageBox(self):
		MessageBox.Show(self._messageError, self._typeError, MessageBoxButtons.OK, MessageBoxIcon.Error)
		



#______________________FIND EXCEL FILE______________________

import os
clr.AddReference('RevitAPI')
from Autodesk.Revit.DB import*
clr.AddReference('RevitServices')
from RevitServices.Persistence import DocumentManager

doc = DocumentManager.Instance.CurrentDBDocument
path = doc.PathName

# Check if the path is empty
if not path:
    raise ValidationError("Revit document is not saved", "First save the Revit document, and make sure db.xlsx is located at the same folder")

dir_name = os.path.dirname(path)

db = "db.csv"

new_path = os.path.join(dir_name, db)

# Check if the file exists at the new path
if not os.path.isfile(new_path):
    raise ValidationError("db.xlsx file is not found", "Please save the db.xlsx file in the same folder with the current Revit document")

#______________________LOAD EXCEL FILE______________________

clr.AddReference('System')
clr.AddReference('System.Data')
from System.IO import FileInfo, StreamReader
from System.Data import DataTable
from System.Text import UTF8Encoding

reader = StreamReader(new_path, UTF8Encoding(True))
column1_data = []
column2_data = []
search_block = IN[0]
in_search_block = False
line = reader.ReadLine()
while line != None:
    fields = line.Split('\t')
    if fields[0] == search_block:
        in_search_block = True
    elif in_search_block and fields[0] != "":
        column1_data.append(fields[0])
        column2_data.append(fields[1])
    elif in_search_block and fields[0] == "":
        break
    line = reader.ReadLine()
reader.Close()

# check if the block exists
if not column1_data and not column2_data:
	raise ValidationError("Could not find", "The specified parameter is not found in the db.csv file")

OUT = (column1_data, column2_data)
# ----------------------------------------
python_script = Python(IN[0]=excel_database)
# ---------- python_script.python (1 lines) ----------
OUT = IN[0][0]
# ----------------------------------------
watch = Watch(python_script)
python_script_2 = Python(IN[0]=excel_database)
# ---------- python_script_2.python (1 lines) ----------
OUT = IN[0][1]
# ----------------------------------------
watch_2 = Watch(python_script_2)

boolean = BoolSelector(false)
select_lines = Python(IN[0]=boolean)
# ---------- select_lines.python (24 lines) ----------
import clr
clr.AddReference('RevitAPI')
clr.AddReference('RevitAPIUI')
clr.AddReference('RevitNodes')
clr.AddReference('RevitServices')
from Autodesk.Revit.DB import *
from Autodesk.Revit.UI import *
import Revit
import RevitServices
from RevitServices.Persistence import DocumentManager
from RevitServices.Transactions import TransactionManager

doc = DocumentManager.Instance.CurrentDBDocument
uidoc = DocumentManager.Instance.CurrentUIApplication.ActiveUIDocument

# Check if the input is True
if IN[0] == True:
    # Prompt the user to select objects
    selected_ids = uidoc.Selection.PickObjects(Selection.ObjectType.Element)
    # Convert the selected ids to elements
    selected_elements = [doc.GetElement(id) for id in selected_ids]
    OUT = selected_elements
else:
    OUT = []
# ----------------------------------------
watch_3 = Watch(select_lines)
boolean_2 = BoolSelector(false)

# group: dropdown ribbon (does not updates when value changes, except if boolean value is changed)
DROPDOWN = Python(IN[0]=python_script, IN[1]=boolean_2)  # frozen
# ---------- DROPDOWN.python (127 lines) ----------
import os
import System
import clr
clr.AddReference('RevitAPI')
clr.AddReference('RevitAPIUI')
clr.AddReference('RevitNodes')
clr.AddReference('RevitServices')
clr.AddReference('PresentationCore')
clr.AddReference('AdWindows')
import Autodesk.Windows as adWin
from Autodesk.Revit.DB import *
from Autodesk.Revit.UI import *
import Revit
import RevitServices
from RevitServices.Persistence import DocumentManager
from RevitServices.Transactions import TransactionManager

# Get the current Revit application UI
doc = DocumentManager.Instance.CurrentDBDocument
uiapp = DocumentManager.Instance.CurrentUIApplication
uidoc = uiapp.ActiveUIDocument
app = uiapp.Application




#________________________________CREATE RIBBON TAB
tabName = 'MishaTab'
# Check if the tab already exists
tabs = adWin.ComponentManager.Ribbon
tab = None
for t in tabs.Tabs:
    name = t.AutomationName
    if name == tabName:
        tab = t
        break
# If the tab doesn't exist, create a new one
if tab is None:
    tab = uiapp.CreateRibbonTab(tabName)

#________________________________CREATE PANEL
panelName = 'MishaPanel'
# Check if the panel already exists
panel = None
for p in uiapp.GetRibbonPanels(tab.Id):
	name = p.Name
	if name == panelName:
		panel = p
		break
# If the panel doesn't exist, create a new one
if panel is None:
	panel = uiapp.CreateRibbonPanel(tabName, panelName)
	
#________________________________CREATE DROPDOWN MENU
# Create a ComboBoxData object
dropdownName = 'MishaDrop'
cbData = ComboBoxData(dropdownName) 

# Check if the ComboBox already exists
comboBox = None
for item in panel.GetItems():
	if item.Name == dropdownName:
		comboBox = item
		break
# If the ComboBox doesn't exist, create a new one
values = IN[0]
if comboBox is None:
	comboBox = panel.AddItem(cbData)
	for value in values:
	    comboBox.AddItem(ComboBoxMemberData(value, value))

OUT = comboBox.Current.Name




#________________________________OUTPUT SELECTED VALUE
# Create a new Shared Parameter
paramName = 'ComboBoxSelection'
paramGroup = 'ComboBox Parameters'

# Check if Shared Parameters file exists
definitionFile = app.OpenSharedParameterFile()
if not definitionFile:
	path = doc.PathName
	dir_name = os.path.dirname(path)
	db = "sp.txt"
	new_path = os.path.join(dir_name, db)
	params = app.SharedParametersFilename = new_path # set shared parameters file path
	definitionFile = app.OpenSharedParameterFile()

# Create a Shared Parameter in Shared Parameters file
definitionGroup = definitionFile.Groups.get_Item(paramGroup)
if definitionGroup is None:
    definitionGroup = definitionFile.Groups.Create(paramGroup)
definition = definitionGroup.Definitions.get_Item(paramName)
if definition is None:
    options = ExternalDefinitionCreationOptions(paramName, ParameterType.Text)
    definition = definitionGroup.Definitions.Create(options)
# Create new Category in the Shared Parameter 
sharedParam = doc.ParameterBindings.get_Item(definition)
categorySet = app.Create.NewCategorySet() 
if sharedParam is None:  
	TransactionManager.Instance.EnsureInTransaction(doc)
	categorySet.Insert(doc.Settings.Categories.get_Item(BuiltInCategory.OST_ProjectInformation))
	binding = app.Create.NewInstanceBinding(categorySet)
	doc.ParameterBindings.Insert(definition, binding, BuiltInParameterGroup.PG_TEXT)
	TransactionManager.Instance.TransactionTaskDone()

    
# Track changes in parameter
def on_combobox_changed(sender, args):
    selectedValue = sender.Current
    TransactionManager.Instance.EnsureInTransaction(doc)
    doc.ProjectInformation.get_Parameter(definition.GUID).Set(selectedValue.Name)
    TransactionManager.Instance.TransactionTaskDone()

# Add the event handler to the ComboBox
comboBox.CurrentChanged += on_combobox_changed

# Get the value of the shared parameter
TransactionManager.Instance.EnsureInTransaction(doc)
selectedValue = doc.ProjectInformation.get_Parameter(definition.GUID).AsString()
TransactionManager.Instance.TransactionTaskDone()

# Output the selected value
#OUT = selectedValue
# ----------------------------------------
watch_4 = Watch(DROPDOWN)

# group: dropdown separate window
code_block_2 = CodeBlock(list=python_script) { list: var[]..[]; }  # frozen
boolean_3 = BoolSelector(false)
python_script_3 = Python(IN[0]=code_block_2, IN[2]=boolean_3)  # frozen; unwired: IN[1]
# ---------- python_script_3.python (92 lines) ----------
#Copyright(c) 2016, Dimitar Venkov
# @5devene, dimitar.ven@gmail.com

import clr
clr.AddReference('System.Windows.Forms')
clr.AddReference('System.Drawing')

from System.Drawing import Point, Color, Font
from System.Windows.Forms import *
from System import Array, Object

def tolist(obj1):
	if hasattr(obj1,"__iter__"): return obj1
	else: return [obj1]

def hasInd(l1, i):
	try: l1[i] ; return True
	except: return False

class NameWrap(Object):
	def __init__(self, obj1, name1 = None):
		self.obj = obj1
		if obj1 == None: name1 = "null"
		if name1 == None and obj1 != None: self.name = obj1.ToString()
		else: self.name = name1
	def ToString(self):
		return self.name

class DropDownForm(Form):
	def __init__(self, cm1):
		self.Text = "Select type"
		self.Width = 368
		self.Height = 336
		self.BackColor = Color.FromArgb(40,40,40)
		self.ControlBox = False
		self.TopMost = True
		self.FormBorderStyle = FormBorderStyle.FixedDialog
		self.StartPosition = FormStartPosition.CenterScreen
		
		self.label = Label()
		self.label.Text = cm1
		self.label.Location = Point(5, 5)
		self.label.ForeColor = Color.FromArgb(234,234,234)
		self.label.Font = Font("Calibri", 10)
		self.label.AutoSize = True
		self.Controls.Add(self.label)
		
		self.combo1 = ComboBox()
		self.combo1.Location = Point(5, 31)
		self.combo1.Width = 350
		self.combo1.BackColor = Color.FromArgb(53,53,53)
		self.combo1.ForeColor = Color.FromArgb(234,234,234)
		self.combo1.Font = Font("Calibri", 11)
		self.combo1.MouseClick += self.expand
		self.Controls.Add(self.combo1)
		
		self.button1 = Button()
		self.button1.Text = 'Select'
		self.button1.AutoSize = True
		self.button1.Width = 350
		self.button1.Location = Point(6, 72)
		self.button1.ForeColor = Color.FromArgb(234,234,234)
		self.button1.Font = Font("Calibri", 10)
		self.button1.Click += self.save
		self.Controls.Add(self.button1)
	
	def expand(self, sender, event):
		self.combo1.DroppedDown = True
	def add_range(self,l1):
		self.combo1.Items.AddRange(l1)	
		if l1.Length >= 1:
			self.combo1.SelectedIndex = 0
	def save(self, sender, event):
		self.output1 = self.combo1.SelectedItem
		self.Close()
#safety measure due to automatic mode
if IN[0] == None: l1 = []
else: l1 = tolist(IN[0])
if IN[1] == None: names = None
else: names = tolist(IN[1])

for i in xrange(len(l1)):
	name1 = None
	if hasInd(names, i): name1 = names[i]
	l1[i] = NameWrap(l1[i], name1)
l1_arr = Array[Object](l1)
form = DropDownForm('Choosse and press Select')
form.add_range(l1_arr)
Application.Run(form)
if l1: OUT = form.output1.obj
else: OUT = []
Application.Exit()
# ----------------------------------------
code_block_3 = CodeBlock(selection=python_script_3) { selection; }

# group: dropdown ribbon
DROPDOWN_2 = Python(IN[0]=python_script)
# ---------- DROPDOWN_2.python (118 lines) ----------
import os
import System
import clr
clr.AddReference('RevitAPI')
clr.AddReference('RevitAPIUI')
clr.AddReference('RevitNodes')
clr.AddReference('RevitServices')
clr.AddReference('PresentationCore')
clr.AddReference('AdWindows')
import Autodesk.Windows as adWin
from Autodesk.Revit.DB import *
from Autodesk.Revit.UI import *
import Revit
import RevitServices
from RevitServices.Persistence import DocumentManager
from RevitServices.Transactions import TransactionManager

# Get the current Revit application UI
doc = DocumentManager.Instance.CurrentDBDocument
uiapp = DocumentManager.Instance.CurrentUIApplication
uidoc = uiapp.ActiveUIDocument
app = uiapp.Application


#________________________________CREATE RIBBON TAB
tabName = 'MishaTab'
# Check if the tab already exists
tabs = adWin.ComponentManager.Ribbon
tab = None
for t in tabs.Tabs:
    name = t.AutomationName
    if name == tabName:
        tab = t
        break
# If the tab doesn't exist, create a new one
if tab is None:
    tab = uiapp.CreateRibbonTab(tabName)

#________________________________CREATE PANEL
panelName = 'MishaPanel'
# Check if the panel already exists
panel = None
for p in uiapp.GetRibbonPanels(tab.Id):
	name = p.Name
	if name == panelName:
		panel = p
		break
# If the panel doesn't exist, create a new one
if panel is None:
	panel = uiapp.CreateRibbonPanel(tabName, panelName)
	
#________________________________CREATE DROPDOWN MENU
# Create a ComboBoxData object
dropdownName = 'MishaDrop'
cbData = ComboBoxData(dropdownName) 

# Check if the ComboBox already exists
comboBox = None
for item in panel.GetItems():
	if item.Name == dropdownName:
		comboBox = item
		break
# If the ComboBox doesn't exist, create a new one
values = IN[0]
if comboBox is None:
	comboBox = panel.AddItem(cbData)
	for value in values:
	    comboBox.AddItem(ComboBoxMemberData(value, value))

OUT = comboBox.Current.Name




#________________________________OUTPUT SELECTED VALUE
# Create a new Shared Parameter
paramName = 'ComboBoxSelection'
paramGroup = 'ComboBox Parameters'

# Check if Shared Parameters file exists
definitionFile = app.OpenSharedParameterFile()
if not definitionFile:
	path = doc.PathName
	dir_name = os.path.dirname(path)
	db = "sp.txt"
	new_path = os.path.join(dir_name, db)
	params = app.SharedParametersFilename = new_path # set shared parameters file path
	definitionFile = app.OpenSharedParameterFile()

# Create a Shared Parameter in Shared Parameters file
definitionGroup = definitionFile.Groups.get_Item(paramGroup)
if definitionGroup is None:
    definitionGroup = definitionFile.Groups.Create(paramGroup)
definition = definitionGroup.Definitions.get_Item(paramName)
if definition is None:
    options = ExternalDefinitionCreationOptions(paramName, ParameterType.Text)
    definition = definitionGroup.Definitions.Create(options)
# Create new Category in the Shared Parameter 
sharedParam = doc.ParameterBindings.get_Item(definition)
categorySet = app.Create.NewCategorySet() 
if sharedParam is None:  
	TransactionManager.Instance.EnsureInTransaction(doc)
	categorySet.Insert(doc.Settings.Categories.get_Item(BuiltInCategory.OST_ProjectInformation))
	binding = app.Create.NewInstanceBinding(categorySet)
	doc.ParameterBindings.Insert(definition, binding, BuiltInParameterGroup.PG_TEXT)
	TransactionManager.Instance.TransactionTaskDone()

    
# Track changes in parameter
def on_combobox_changed(sender, args):
	TransactionManager.Instance.EnsureInTransaction(doc)
	selectedValue = sender.Current
	TransactionManager.Instance.TransactionTaskDone()

# Add the event handler to the ComboBox
comboBox.CurrentChanged += on_combobox_changed

OUT = comboBox.Current.Name 
# ----------------------------------------
watch_5 = Watch(DROPDOWN_2)

python_script_4 = Python()  # unwired: IN[0]
# ---------- python_script_4.python (81 lines) ----------
import os
import System
import clr
clr.AddReference('RevitAPI')
clr.AddReference('RevitAPIUI')
clr.AddReference('RevitNodes')
clr.AddReference('RevitServices')
clr.AddReference('PresentationCore')
clr.AddReference('AdWindows')
import Autodesk
import Autodesk.Windows as adWin
from Autodesk.Revit.DB import *
from Autodesk.Revit.UI import *
import Revit
import RevitServices
from RevitServices.Persistence import DocumentManager
from RevitServices.Transactions import TransactionManager
clr.AddReference('DynamoCore')
clr.AddReference('DynamoRevitDS')
from Dynamo.Applications import *
from Dynamo.Graph.Nodes import *

# Get the current Revit application UI
doc = DocumentManager.Instance.CurrentDBDocument
uiapp = DocumentManager.Instance.CurrentUIApplication
uidoc = uiapp.ActiveUIDocument
app = uiapp.Application

path = doc.PathName
dir_name = os.path.dirname(path)
script_name = '2.rvt'
new_path = os.path.join(dir_name, script_name)


#________________________________CREATE RIBBON TAB
tabName = 'MishaTab'
# Check if the tab already exists
tabs = adWin.ComponentManager.Ribbon
tab = None
for t in tabs.Tabs:
    name = t.AutomationName
    if name == tabName:
        tab = t
        break
# If the tab doesn't exist, create a new one
if tab is None:
    tab = uiapp.CreateRibbonTab(tabName)

#________________________________CREATE PANEL
panelName = 'MishaPanel'
# Check if the panel already exists
panel = None
for p in uiapp.GetRibbonPanels(tab.Id):
	name = p.Name
	if name == panelName:
		panel = p
		break
# If the panel doesn't exist, create a new one
if panel is None:
	panel = uiapp.CreateRibbonPanel(tabName, panelName)

#________________________________CREATE BUTTON

dllPath = r'C:\_Misha\temporal\jap\DynamoScript\Test\test\bin\Debug\net8.0\test.dll'
clr.AddReferenceToFileAndPath(dllPath)
from test import Testing

buttonName = 'MishaButton'
buttonData = PushButtonData(buttonName, 'Apply', dllPath, 'test.Testing')

# Check if the PushButton already exists
button = None
for item in panel.GetItems():
	if item.Name == buttonName:
		button = item
		break
# If the PushButton doesn't exist, create a new one
if button is None:
	button = panel.AddItem(buttonData)

OUT = button.Name
# ----------------------------------------
python_script_5 = Python()  # frozen; unwired: IN[0]
# ---------- python_script_5.python (16 lines) ----------
import clr
clr.AddReference('System.Windows.Forms')
clr.AddReference('System.Drawing')

from System.Drawing import Point, Color, Font
from System.Windows.Forms import *
from System import Array, Object

class Test(Form):
	def __init__(self):
		self.Text = 'HIIII'

t = Test()

Application.Run(t)
Application.Exit()
# ----------------------------------------
